# Dynamo graph Quan - Cabling Generator（Shortest Path by Topologic）.dyn "Topology Linkedin Post" (Dynamo 2.6.1.8786)
# packages: MEPover 2022.1.1, Clockwork for Dynamo 2.x 2.3.0, Topologic 1.4.0, Universo_BIM 19.10.11, archi-lab.net 2022.212.3121, LunchBox for Dynamo 2018.7.7

# group: POINTS ON TIER1 CLOSEST TO RACKS
categories = Categories("OST_DataDevices")
views = Views("T02.01-OVERALL")
all_elements_of_category_in_view = ElementsOfCategoryInView(Category=categories, View=views)
location = Custom[Element.Location+](element=all_elements_of_category_in_view, lacing=Shortest)  # package Clockwork for Dynamo 2.x; Returns the location of an element as point, curve or curve loop, along with some booleans to help filtering the results. Unlike the OOTB Element.GetLocation node, it also retunrs sketch lines of sketch-based elements like floor slabs as well as the element's rotation property.
watch = Watch(location.points)
flatten = List.Flatten(list=watch)

# group: TRAYS LOCATIONS LINE
categories_2 = Categories("OST_CableTray")
views_2 = Views("T02.01-OVERALL")
all_elements_of_category_in_view_2 = ElementsOfCategoryInView(Category=categories_2, View=views_2)
getLocation = Element.GetLocation(element=all_elements_of_category_in_view_2)

# group: FILTER OUT CLOSEST LINES OF RACKS
distanceTo = Geometry.DistanceTo(geometry=watch@L1, other=getLocation, lacing=CrossProduct)
minimumItem = List.MinimumItem(list=distanceTo)
watch_2 = Watch(getLocation)
watch_3 = Watch(distanceTo)
sortIndexByValue = List.SortIndexByValue(list=watch_3)
firstItem = List.FirstItem(list=sortIndexByValue@@L2)
getItemAtIndex = List.GetItemAtIndex(list=watch_2, index=firstItem)

# group: TRAY FITTINGS LOCATION POINTS
categories_3 = Categories("OST_CableTrayFitting")
views_3 = Views("T02.01-OVERALL")
all_elements_of_category_in_view_3 = ElementsOfCategoryInView(Category=categories_3, View=views_3)
getLocation_2 = Element.GetLocation(element=all_elements_of_category_in_view_3)

watch_4 = Watch(getLocation_2)

# group: ENDPOINTS OF TRAYS(CONNECTED BY FITTINGS)
mep_fitting_connected_mepcurves = Custom[MEP Fitting connected MEPCurves](Fittings=all_elements_of_category_in_view_3)  # package MEPover; Returns the pipes, ducts, conduits or cable trays that are connected to the given fittings
location_2 = Custom[Element.Location+](element=mep_fitting_connected_mepcurves, lacing=Shortest)

watch_5 = Watch(location_2.curveEndpoints)

# group: FILTER OUT THE LINES BETWEEN FITTING LOCATIONS AND CLOSEST POINTS OF CONNECTED TRAYS
byStartPointEndPoint = Line.ByStartPointEndPoint(startPoint=watch_4, endPoint=watch_5)
length = Curve.Length(curve=byStartPointEndPoint)
minimumItem_2 = List.MinimumItem(list=length@@L2)
eq = Equals(x=length, y=minimumItem_2)
filterByBoolMask = List.FilterByBoolMask(list=byStartPointEndPoint, mask=eq)

watch_6 = Watch(filterByBoolMask.in)
location_3 = Custom[Element.Location+](element=all_elements_of_category_in_view_2, lacing=Shortest)
watch_7 = Watch(location_3.curves)
list_create = List.Create(item0=watch_6, item1=watch_7)
flatten_2 = List.Flatten(list=list_create)
byGeometry = Topologic.Topology.ByGeometry(geometry=flatten_2)

# group (continued): POINTS ON TIER1 CLOSEST TO RACKS
closestPointTo = Geometry.ClosestPointTo(geometry=getItemAtIndex, other=flatten)

code_block = CodeBlock { 0; 1; }
getItemAtIndex_2 = List.GetItemAtIndex(list=closestPointTo, index=code_block.out0)
byGeometry_2 = Topologic.Topology.ByGeometry(geometry=getItemAtIndex_2)
getItemAtIndex_3 = List.GetItemAtIndex(list=closestPointTo, index=code_block.out1)
byGeometry_3 = Topologic.Topology.ByGeometry(geometry=getItemAtIndex_3)
list_create_2 = List.Create(item0=byGeometry, item1=byGeometry_2, item2=byGeometry_3)

# group: Topologic - Shortest Pathway
flatten_3 = List.Flatten(list=list_create_2)
byTopologies = Topologic.Cluster.ByTopologies(topologies=flatten_3)
selfMerge = Topologic.Topology.SelfMerge(topology=byTopologies)
byTopology = Topologic.Graph.ByTopology(topology=selfMerge, lacing=Longest)
vertices = Topologic.Graph.Vertices(graph=byTopology)
distance = Topologic.Utilities.VertexUtility.Distance(vertex=byGeometry_2, topology=vertices, lacing=CrossProduct)
sortByKey = List.SortByKey(list=vertices, keys=distance@@L2)
flatten_4 = List.Flatten(list=sortByKey.sorted_list)
code_block_2 = CodeBlock(v=flatten_4) { v[0]; }
distance_2 = Topologic.Utilities.VertexUtility.Distance(vertex=byGeometry_3, topology=vertices, lacing=CrossProduct)
sortByKey_2 = List.SortByKey(list=vertices, keys=distance_2@@L2)
flatten_5 = List.Flatten(list=sortByKey_2.sorted_list)
code_block_3 = CodeBlock(v=flatten_5) { v[0]; }
shortestPath = Topologic.Graph.ShortestPath(graph=byTopology, startVertex=code_block_2, endVertex=code_block_3, lacing=CrossProduct)

geometry = Topologic.Topology.Geometry(topology=shortestPath)

# group: Geometry Line to Conduits w/ fitting
deconstructPolyCurve = Geometry.Curves.DeconstructPolyCurve(polycurve=geometry)
select_model_element = DSModelElementSelection()  # 1 picked in the model
type = archilab.Revit.Elements.Elements.Type(element=select_model_element)
levels = Levels("KWT - L1")
byCurve = Elements.Conduit.ByCurve(curve=deconstructPolyCurve.Segments, conduitType=type, level=levels)
code_block_4 = CodeBlock { 1; }
byMEPCurves = Custom[Elbow.ByMEPCurves](MEPCurves=byCurve, Margin=code_block_4)  # package MEPover; Takes in a list of MEPCurves (pipe, duct, cable tray, conduit) and will attempt to create elbows where possible. A margin can be entered for max distance between connectors
