# Dynamo graph Quan - Elevation Maker.dyn (Dynamo 2.6.1.8786)
# packages: archi-lab.net 2022.212.3121, MEPover 2020.6.2, Data-Shapes 2022.2.101, Rhythm 2022.1.2

code_block = CodeBlock { "Quan - ELEVATION MAKER & VIEWPORT"; }
file_path = Filename("..\..\OneDrive - kW Mission Critical Engineering\Desktop\kw_logo.png")
code_block_2 = CodeBlock { "Create Elevation Marker on Callout View"; }
code_block_3 = CodeBlock { "Select Callout View"; }
element_types = ElementTypes("ViewPlan")
all_elements_of_type = ElementsOfType(element_type=element_types)
dropdown_data = Custom[DropDown Data](InputName=code_block_3, Keys=all_elements_of_type, Values=all_elements_of_type)  # package Data-Shapes; Create data for DropDown input in UI.MultiInputForm ++ . Check out www.data-shapes.net for more infos.
inputgroup_data = Custom[InputGroup Data](GroupTitle=code_block_2, Inputs=dropdown_data)  # package Data-Shapes; Creates a group of inputs for UI.MultipleInputForm ++ . Check out www.data-shapes.net for more infos !
code_block_4 = CodeBlock { "Set Elevation Views' Porperty"; }
code_block_5 = CodeBlock { "View Family Type"; }
element_types_2 = ElementTypes("ViewFamilyType")
all_elements_of_type_2 = ElementsOfType(element_type=element_types_2)
name = Element.Name(element=all_elements_of_type_2)
dropdown_data_2 = Custom[DropDown Data](InputName=code_block_5, Keys=name, Values=all_elements_of_type_2)
code_block_6 = CodeBlock { "View Template"; }
element_types_3 = ElementTypes("View")
all_elements_of_type_3 = ElementsOfType(element_type=element_types_3)
python_script = Python(IN[0]=all_elements_of_type_3)
# ---------- python_script.python (18 lines) ----------
import clr
clr.AddReference('RevitAPI')
from Autodesk.Revit.DB import *

views = UnwrapElement(IN[0])
template_list = []
not_template_list=[]

for view in views:
	try:
		if view.IsTemplate:
			template_list.append(view)
		else:
			not_template_list.append(view)
	except:
		not_template_list.append(view)

OUT = template_list,not_template_list
# ----------------------------------------
code_block_7 = CodeBlock(i=python_script) { i[0]; i[1]; }
watch = Watch(code_block_7.out0)
name_2 = Element.Name(element=watch)
dropdown_data_3 = Custom[DropDown Data](InputName=code_block_6, Keys=name_2, Values=watch)
list_create = List.Create(item0=dropdown_data_2, item1=dropdown_data_3)
inputgroup_data_2 = Custom[InputGroup Data](GroupTitle=code_block_4, Inputs=list_create)
code_block_8 = CodeBlock { "Set Elevation Range"; }
code_block_9 = CodeBlock { "Set Top Level of Elevation"; }
element_types_4 = ElementTypes("Level")
all_elements_of_type_4 = ElementsOfType(element_type=element_types_4)
name_3 = Element.Name(element=all_elements_of_type_4)
dropdown_data_4 = Custom[DropDown Data](InputName=code_block_9, Keys=name_3, Values=all_elements_of_type_4)
code_block_10 = CodeBlock { "Set Bottom Level of Elevation"; }
element_types_5 = ElementTypes("Level")
all_elements_of_type_5 = ElementsOfType(element_type=element_types_5)
name_4 = Element.Name(element=all_elements_of_type_5)
dropdown_data_5 = Custom[DropDown Data](InputName=code_block_10, Keys=name_4, Values=all_elements_of_type_5)
code_block_11 = CodeBlock { "Select Level_1 as Reference Level"; }
element_types_6 = ElementTypes("Level")
all_elements_of_type_6 = ElementsOfType(element_type=element_types_6)
name_5 = Element.Name(element=all_elements_of_type_6)
dropdown_data_6 = Custom[DropDown Data](InputName=code_block_11, Keys=name_5, Values=all_elements_of_type_6)
list_create_2 = List.Create(item0=dropdown_data_4, item1=dropdown_data_5, item2=dropdown_data_6)
inputgroup_data_3 = Custom[InputGroup Data](GroupTitle=code_block_8, Inputs=list_create_2)
code_block_12 = CodeBlock { "Viewport"; }
code_block_13 = CodeBlock { "Select Sheet"; }
element_types_7 = ElementTypes("ViewSheet")
all_elements_of_type_7 = ElementsOfType(element_type=element_types_7)
dropdown_data_7 = Custom[DropDown Data](InputName=code_block_13, Keys=all_elements_of_type_7, Values=all_elements_of_type_7)
inputgroup_data_4 = Custom[InputGroup Data](GroupTitle=code_block_12, Inputs=dropdown_data_7)
list_create_3 = List.Create(item0=inputgroup_data, item1=inputgroup_data_2, item2=inputgroup_data_3, item3=inputgroup_data_4)
boolean = BoolSelector(true)
code_block_14 = CodeBlock { "Cancel"; }
code_block_15 = CodeBlock { 400; 660; }
multipleinputform = Custom[MultipleInputForm ++](Description_optional=code_block, Logo_optional=file_path, Inputs=list_create_3, Toggle=boolean, CancelButtonText_optional=code_block_14, Width_optional=code_block_15.out1)  # package Data-Shapes; Create a form with multiple inputs. see www.data-shapes.net for tutorials and infos!
watch_2 = Watch(multipleinputform.User_Inputs)
code_block_16 = CodeBlock { 0; }

# group: Imput View
getItemAtIndex = List.GetItemAtIndex(list=watch_2, index=code_block_16)

# group: Rename
cropBox = archilab.Revit.Views.Views.CropBox(view=getItemAtIndex)
code_block_17 = CodeBlock { "View Name"; }
getParameterValueByName = Element.GetParameterValueByName(element=getItemAtIndex, parameterName=code_block_17)

# group: ViewFamilyType
code_block_18 = CodeBlock { 1; }
getItemAtIndex_2 = List.GetItemAtIndex(list=watch_2, index=code_block_18)

# group: EAST
getCropBoxCurves = Custom[View.GetCropBoxCurves](views=getItemAtIndex@L1)  # package MEPover; returns the curves of a view crop box, even irregular shapes. Returns an empty list if the crop view is not active for a given view
startPoint = Curve.StartPoint(curve=getCropBoxCurves@L1)
code_block_19 = CodeBlock { 0; 2; }
getItemAtIndex_3 = List.GetItemAtIndex(list=startPoint, index=code_block_19.out0)
X = Point.X(point=getItemAtIndex_3)
getItemAtIndex_4 = List.GetItemAtIndex(list=startPoint, index=code_block_19.out1)
X_2 = Point.X(point=getItemAtIndex_4)
add = X + X_2
code_block_20 = CodeBlock { 2; }
div = add / code_block_20
number_slider = DoubleSlider(0, range=-4..4 step 1)
code_block_21 = CodeBlock(a=div, b=number_slider) { a+b+2; }
Y = Point.Y(point=getItemAtIndex_3)
Y_2 = Point.Y(point=getItemAtIndex_4)
add_2 = Y + Y_2
div_2 = add_2 / code_block_20
number_slider_2 = DoubleSlider(0, range=-4..4 step 1)
code_block_22 = CodeBlock(a=div_2, b=number_slider_2) { a+b; }
byCoordinates = Point.ByCoordinates(x=code_block_21, y=code_block_22)
code_block_23 = CodeBlock { 96; }
byViewTypeLocation = ElevationMarker.ByViewTypeLocation(viewFamilyType=getItemAtIndex_2, location=byCoordinates, initialViewScale=code_block_23)
code_block_24 = CodeBlock { 2; }
createElevationByMarkerIndex = ElevationMarker.CreateElevationByMarkerIndex(elevationMarker=byViewTypeLocation, planView=getItemAtIndex, index=code_block_24@L1)

code_block_25 = CodeBlock { 2; }

# group: View Templates
view_templates = ViewTemplatesUi()  # nothing selected; graph input
getItemAtIndex_5 = List.GetItemAtIndex(list=watch_2, index=code_block_25)

# group: Name
setViewTemplate = archilab.Revit.Views.Views.SetViewTemplate(view=createElevationByMarkerIndex, viewTemplate=getItemAtIndex_5)
length = String.Length(str=getParameterValueByName)
code_block_26 = CodeBlock { " - EAST"; }
insert = String.Insert(str=getParameterValueByName, index=length, toInsert=code_block_26)
setName = archilab.Revit.Views.Views.SetName(view=setViewTemplate, name=insert)

getCropBoxCurves_2 = Custom[View.GetCropBoxCurves](views=setName)
startPoint_2 = Curve.StartPoint(curve=getCropBoxCurves_2)
X_3 = Point.X(point=startPoint_2)
Y_3 = Point.Y(point=startPoint_2)
Z = Point.Z(point=startPoint_2)
maximumItem = List.MaximumItem(list=Z)
code_block_27 = CodeBlock { 4; }
getItemAtIndex_6 = List.GetItemAtIndex(list=watch_2, index=code_block_27)
elevation = Level.Elevation(level=getItemAtIndex_6)
sort = List.Sort(list=elevation)
code_block_28 = CodeBlock { 5; }
getItemAtIndex_7 = List.GetItemAtIndex(list=watch_2, index=code_block_28)
elevation_2 = Level.Elevation(level=getItemAtIndex_7)
code_block_29 = CodeBlock(a=sort, b=elevation_2) { a-b-0.5; }
code_block_30 = CodeBlock(a=Z, b=maximumItem, c=code_block_29) { a==b?c:a; }
minimumItem = List.MinimumItem(list=Z)
code_block_31 = CodeBlock { 3; }
getItemAtIndex_8 = List.GetItemAtIndex(list=watch_2, index=code_block_31)
elevation_3 = Level.Elevation(level=getItemAtIndex_8)
sort_2 = List.Sort(list=elevation_3)
elevation_4 = Level.Elevation(level=getItemAtIndex_7)
code_block_32 = CodeBlock(a=sort_2, b=elevation_4) { a-b+1; }
code_block_33 = CodeBlock(a=code_block_30, b=minimumItem, c=code_block_32) { a==b?c:a; }
byCoordinates_2 = Point.ByCoordinates(x=X_3, y=Y_3, z=code_block_33)
code_block_34 = CodeBlock { 0; }
getItemAtIndex_9 = List.GetItemAtIndex(list=byCoordinates_2@@L2, index=code_block_34)
code_block_35 = CodeBlock { 1; }
getItemAtIndex_10 = List.GetItemAtIndex(list=byCoordinates_2@@L2, index=code_block_35)
byStartPointEndPoint = Line.ByStartPointEndPoint(startPoint=getItemAtIndex_9, endPoint=getItemAtIndex_10)
code_block_36 = CodeBlock { 2; }
getItemAtIndex_11 = List.GetItemAtIndex(list=byCoordinates_2@@L2, index=code_block_36)
byStartPointEndPoint_2 = Line.ByStartPointEndPoint(startPoint=getItemAtIndex_10, endPoint=getItemAtIndex_11)
code_block_37 = CodeBlock { 3; }
getItemAtIndex_12 = List.GetItemAtIndex(list=byCoordinates_2@@L2, index=code_block_37)
byStartPointEndPoint_3 = Line.ByStartPointEndPoint(startPoint=getItemAtIndex_11, endPoint=getItemAtIndex_12)
byStartPointEndPoint_4 = Line.ByStartPointEndPoint(startPoint=getItemAtIndex_12, endPoint=getItemAtIndex_9)
list_create_4 = List.Create(item0=byStartPointEndPoint, item1=byStartPointEndPoint_2, item2=byStartPointEndPoint_3, item3=byStartPointEndPoint_4)
flatten = List.Flatten(list=list_create_4)
setCropBoxByCurves = archilab.Revit.Views.Views.SetCropBoxByCurves(view=setName, curves=flatten)  # graph output

# group: North
getCropBoxCurves_3 = Custom[View.GetCropBoxCurves](views=getItemAtIndex@L1)
startPoint_3 = Curve.StartPoint(curve=getCropBoxCurves_3@L1)
code_block_38 = CodeBlock { 0; 2; }
getItemAtIndex_13 = List.GetItemAtIndex(list=startPoint_3, index=code_block_38.out0)
X_4 = Point.X(point=getItemAtIndex_13)
getItemAtIndex_14 = List.GetItemAtIndex(list=startPoint_3, index=code_block_38.out1)
X_5 = Point.X(point=getItemAtIndex_14)
add_3 = X_4 + X_5
code_block_39 = CodeBlock { 2; }
div_3 = add_3 / code_block_39
number_slider_3 = DoubleSlider(0, range=-4..4 step 1)
code_block_40 = CodeBlock(a=div_3, b=number_slider_3) { a+b; }
Y_4 = Point.Y(point=getItemAtIndex_13)
Y_5 = Point.Y(point=getItemAtIndex_14)
add_4 = Y_4 + Y_5
div_4 = add_4 / code_block_39
number_slider_4 = DoubleSlider(0, range=-4..4 step 1)
code_block_41 = CodeBlock(a=div_4, b=number_slider_4) { a+b+2; }
byCoordinates_3 = Point.ByCoordinates(x=code_block_40, y=code_block_41)
code_block_42 = CodeBlock { 96; }
byViewTypeLocation_2 = ElevationMarker.ByViewTypeLocation(viewFamilyType=getItemAtIndex_2, location=byCoordinates_3, initialViewScale=code_block_42)
code_block_43 = CodeBlock { 1; }
createElevationByMarkerIndex_2 = ElevationMarker.CreateElevationByMarkerIndex(elevationMarker=byViewTypeLocation_2, planView=getItemAtIndex, index=code_block_43@L1)

# group: Name
setViewTemplate_2 = archilab.Revit.Views.Views.SetViewTemplate(view=createElevationByMarkerIndex_2, viewTemplate=getItemAtIndex_5)
length_2 = String.Length(str=getParameterValueByName)
code_block_44 = CodeBlock { " - NORTH"; }
insert_2 = String.Insert(str=getParameterValueByName, index=length_2, toInsert=code_block_44)
setName_2 = archilab.Revit.Views.Views.SetName(view=setViewTemplate_2, name=insert_2)

getCropBoxCurves_4 = Custom[View.GetCropBoxCurves](views=setName_2)
startPoint_4 = Curve.StartPoint(curve=getCropBoxCurves_4)
X_6 = Point.X(point=startPoint_4)
Y_6 = Point.Y(point=startPoint_4)
Z_2 = Point.Z(point=startPoint_4)
maximumItem_2 = List.MaximumItem(list=Z_2)
code_block_45 = CodeBlock(a=Z_2, b=maximumItem_2, c=code_block_29) { a==b?c:a; }
minimumItem_2 = List.MinimumItem(list=Z_2)
code_block_46 = CodeBlock(a=code_block_45, b=minimumItem_2, c=code_block_32) { a==b?c:a; }
byCoordinates_4 = Point.ByCoordinates(x=X_6, y=Y_6, z=code_block_46)
code_block_47 = CodeBlock { 0; }
getItemAtIndex_15 = List.GetItemAtIndex(list=byCoordinates_4@@L2, index=code_block_47)
code_block_48 = CodeBlock { 1; }
getItemAtIndex_16 = List.GetItemAtIndex(list=byCoordinates_4@@L2, index=code_block_48)
byStartPointEndPoint_5 = Line.ByStartPointEndPoint(startPoint=getItemAtIndex_15, endPoint=getItemAtIndex_16)
code_block_49 = CodeBlock { 2; }
getItemAtIndex_17 = List.GetItemAtIndex(list=byCoordinates_4@@L2, index=code_block_49)
byStartPointEndPoint_6 = Line.ByStartPointEndPoint(startPoint=getItemAtIndex_16, endPoint=getItemAtIndex_17)
code_block_50 = CodeBlock { 3; }
getItemAtIndex_18 = List.GetItemAtIndex(list=byCoordinates_4@@L2, index=code_block_50)
byStartPointEndPoint_7 = Line.ByStartPointEndPoint(startPoint=getItemAtIndex_17, endPoint=getItemAtIndex_18)
byStartPointEndPoint_8 = Line.ByStartPointEndPoint(startPoint=getItemAtIndex_18, endPoint=getItemAtIndex_15)
list_create_5 = List.Create(item0=byStartPointEndPoint_5, item1=byStartPointEndPoint_6, item2=byStartPointEndPoint_7, item3=byStartPointEndPoint_8)
flatten_2 = List.Flatten(list=list_create_5)
setCropBoxByCurves_2 = archilab.Revit.Views.Views.SetCropBoxByCurves(view=setName_2, curves=flatten_2)  # graph output

# group: WEST
getCropBoxCurves_5 = Custom[View.GetCropBoxCurves](views=getItemAtIndex@L1)
startPoint_5 = Curve.StartPoint(curve=getCropBoxCurves_5@L1)
code_block_51 = CodeBlock { 0; 2; }
getItemAtIndex_19 = List.GetItemAtIndex(list=startPoint_5, index=code_block_51.out0)
X_7 = Point.X(point=getItemAtIndex_19)
getItemAtIndex_20 = List.GetItemAtIndex(list=startPoint_5, index=code_block_51.out1)
X_8 = Point.X(point=getItemAtIndex_20)
add_5 = X_7 + X_8
code_block_52 = CodeBlock { 2; }
div_5 = add_5 / code_block_52
number_slider_5 = DoubleSlider(0, range=-4..4 step 1)
code_block_53 = CodeBlock(a=div_5, b=number_slider_5) { a+b-2; }
Y_7 = Point.Y(point=getItemAtIndex_19)
Y_8 = Point.Y(point=getItemAtIndex_20)
add_6 = Y_7 + Y_8
div_6 = add_6 / code_block_52
number_slider_6 = DoubleSlider(0, range=-4..4 step 1)
code_block_54 = CodeBlock(a=div_6, b=number_slider_6) { a+b; }
byCoordinates_5 = Point.ByCoordinates(x=code_block_53, y=code_block_54)
code_block_55 = CodeBlock { 96; }
byViewTypeLocation_3 = ElevationMarker.ByViewTypeLocation(viewFamilyType=getItemAtIndex_2, location=byCoordinates_5, initialViewScale=code_block_55)
code_block_56 = CodeBlock { 0; }
createElevationByMarkerIndex_3 = ElevationMarker.CreateElevationByMarkerIndex(elevationMarker=byViewTypeLocation_3, planView=getItemAtIndex, index=code_block_56@L1)

# group: Name
setViewTemplate_3 = archilab.Revit.Views.Views.SetViewTemplate(view=createElevationByMarkerIndex_3, viewTemplate=getItemAtIndex_5)
length_3 = String.Length(str=getParameterValueByName)
code_block_57 = CodeBlock { " - WEST"; }
insert_3 = String.Insert(str=getParameterValueByName, index=length_3, toInsert=code_block_57)
setName_3 = archilab.Revit.Views.Views.SetName(view=setViewTemplate_3, name=insert_3)

getCropBoxCurves_6 = Custom[View.GetCropBoxCurves](views=setViewTemplate_3)
startPoint_6 = Curve.StartPoint(curve=getCropBoxCurves_6)
X_9 = Point.X(point=startPoint_6)
Y_9 = Point.Y(point=startPoint_6)
Z_3 = Point.Z(point=startPoint_6)
maximumItem_3 = List.MaximumItem(list=Z_3)
code_block_58 = CodeBlock(a=Z_3, b=maximumItem_3, c=code_block_29) { a==b?c:a; }
minimumItem_3 = List.MinimumItem(list=Z_3)
code_block_59 = CodeBlock(a=code_block_58, b=minimumItem_3, c=code_block_32) { a==b?c:a; }
byCoordinates_6 = Point.ByCoordinates(x=X_9, y=Y_9, z=code_block_59)
code_block_60 = CodeBlock { 0; }
getItemAtIndex_21 = List.GetItemAtIndex(list=byCoordinates_6@@L2, index=code_block_60)
code_block_61 = CodeBlock { 1; }
getItemAtIndex_22 = List.GetItemAtIndex(list=byCoordinates_6@@L2, index=code_block_61)
byStartPointEndPoint_9 = Line.ByStartPointEndPoint(startPoint=getItemAtIndex_21, endPoint=getItemAtIndex_22)
code_block_62 = CodeBlock { 2; }
getItemAtIndex_23 = List.GetItemAtIndex(list=byCoordinates_6@@L2, index=code_block_62)
byStartPointEndPoint_10 = Line.ByStartPointEndPoint(startPoint=getItemAtIndex_22, endPoint=getItemAtIndex_23)
code_block_63 = CodeBlock { 3; }
getItemAtIndex_24 = List.GetItemAtIndex(list=byCoordinates_6@@L2, index=code_block_63)
byStartPointEndPoint_11 = Line.ByStartPointEndPoint(startPoint=getItemAtIndex_23, endPoint=getItemAtIndex_24)
byStartPointEndPoint_12 = Line.ByStartPointEndPoint(startPoint=getItemAtIndex_24, endPoint=getItemAtIndex_21)
list_create_6 = List.Create(item0=byStartPointEndPoint_9, item1=byStartPointEndPoint_10, item2=byStartPointEndPoint_11, item3=byStartPointEndPoint_12)
flatten_3 = List.Flatten(list=list_create_6)
setCropBoxByCurves_3 = archilab.Revit.Views.Views.SetCropBoxByCurves(view=setName_3, curves=flatten_3)  # graph output

# group: South
getCropBoxCurves_7 = Custom[View.GetCropBoxCurves](views=getItemAtIndex@L1)
startPoint_7 = Curve.StartPoint(curve=getCropBoxCurves_7@L1)
code_block_64 = CodeBlock { 0; 2; }
getItemAtIndex_25 = List.GetItemAtIndex(list=startPoint_7, index=code_block_64.out0)
X_10 = Point.X(point=getItemAtIndex_25)
getItemAtIndex_26 = List.GetItemAtIndex(list=startPoint_7, index=code_block_64.out1)
X_11 = Point.X(point=getItemAtIndex_26)
add_7 = X_10 + X_11
code_block_65 = CodeBlock { 2; }
div_7 = add_7 / code_block_65
number_slider_7 = DoubleSlider(0, range=-4..4 step 1)
code_block_66 = CodeBlock(a=div_7, b=number_slider_7) { a+b; }
Y_10 = Point.Y(point=getItemAtIndex_25)
Y_11 = Point.Y(point=getItemAtIndex_26)
add_8 = Y_10 + Y_11
div_8 = add_8 / code_block_65
number_slider_8 = DoubleSlider(0, range=-4..4 step 1)
code_block_67 = CodeBlock(a=div_8, b=number_slider_8) { a+b-2; }
byCoordinates_7 = Point.ByCoordinates(x=code_block_66, y=code_block_67)
code_block_68 = CodeBlock { 96; }
byViewTypeLocation_4 = ElevationMarker.ByViewTypeLocation(viewFamilyType=getItemAtIndex_2, location=byCoordinates_7, initialViewScale=code_block_68)
code_block_69 = CodeBlock { 3; }
createElevationByMarkerIndex_4 = ElevationMarker.CreateElevationByMarkerIndex(elevationMarker=byViewTypeLocation_4, planView=getItemAtIndex, index=code_block_69@L1)

# group: Name
setViewTemplate_4 = archilab.Revit.Views.Views.SetViewTemplate(view=createElevationByMarkerIndex_4, viewTemplate=getItemAtIndex_5)
length_4 = String.Length(str=getParameterValueByName)
code_block_70 = CodeBlock { " - SOUTH"; }
insert_4 = String.Insert(str=getParameterValueByName, index=length_4, toInsert=code_block_70)
setName_4 = archilab.Revit.Views.Views.SetName(view=setViewTemplate_4, name=insert_4)

getCropBoxCurves_8 = Custom[View.GetCropBoxCurves](views=setName_4)
startPoint_8 = Curve.StartPoint(curve=getCropBoxCurves_8)
X_12 = Point.X(point=startPoint_8)
Y_12 = Point.Y(point=startPoint_8)
Z_4 = Point.Z(point=startPoint_8)
maximumItem_4 = List.MaximumItem(list=Z_4)
code_block_71 = CodeBlock(a=Z_4, b=maximumItem_4, c=code_block_29) { a==b?c:a; }
minimumItem_4 = List.MinimumItem(list=Z_4)
code_block_72 = CodeBlock(a=code_block_71, b=minimumItem_4, c=code_block_32) { a==b?c:a; }
byCoordinates_8 = Point.ByCoordinates(x=X_12, y=Y_12, z=code_block_72)
code_block_73 = CodeBlock { 0; }
getItemAtIndex_27 = List.GetItemAtIndex(list=byCoordinates_8@@L2, index=code_block_73)
code_block_74 = CodeBlock { 1; }
getItemAtIndex_28 = List.GetItemAtIndex(list=byCoordinates_8@@L2, index=code_block_74)
byStartPointEndPoint_13 = Line.ByStartPointEndPoint(startPoint=getItemAtIndex_27, endPoint=getItemAtIndex_28)
code_block_75 = CodeBlock { 2; }
getItemAtIndex_29 = List.GetItemAtIndex(list=byCoordinates_8@@L2, index=code_block_75)
byStartPointEndPoint_14 = Line.ByStartPointEndPoint(startPoint=getItemAtIndex_28, endPoint=getItemAtIndex_29)
code_block_76 = CodeBlock { 3; }
getItemAtIndex_30 = List.GetItemAtIndex(list=byCoordinates_8@@L2, index=code_block_76)
byStartPointEndPoint_15 = Line.ByStartPointEndPoint(startPoint=getItemAtIndex_29, endPoint=getItemAtIndex_30)
byStartPointEndPoint_16 = Line.ByStartPointEndPoint(startPoint=getItemAtIndex_30, endPoint=getItemAtIndex_27)
list_create_7 = List.Create(item0=byStartPointEndPoint_13, item1=byStartPointEndPoint_14, item2=byStartPointEndPoint_15, item3=byStartPointEndPoint_16)
flatten_4 = List.Flatten(list=list_create_7)
setCropBoxByCurves_4 = archilab.Revit.Views.Views.SetCropBoxByCurves(view=setName_4, curves=flatten_4)  # graph output

# group: Imput View
code_block_77 = CodeBlock { 6; }
getItemAtIndex_31 = List.GetItemAtIndex(list=watch_2, index=code_block_77)
list_create_8 = List.Create(item0=setCropBoxByCurves, item1=setCropBoxByCurves_2, item2=setCropBoxByCurves_3, item3=setCropBoxByCurves_4)
code_block_78 = CodeBlock { 0; }
byCoordinates_9 = Point.ByCoordinates(x=code_block_78, y=code_block_78, z=code_block_78)
ʳʰʸᵗʰᵐ_viewport_create = Rhythm.Revit.Elements.Viewport.Create(sheet=getItemAtIndex_31, view=list_create_8@L1, location=byCoordinates_9)
