# Dynamo graph Quan - Sync Viewports Location on the Page (ENLARGED&OVERALL&SEGMENT).dyn "Sync Viewports Location on the Page (ENLARGED&OVERALL&SEGMENT)" (Dynamo 2.6.1.8786)
# packages: archi-lab.net 2022.212.3121, Data-Shapes 2022.2.101, Rhythm 2022.1.2

code_block = CodeBlock { "Quan's Plug-in Demo Ver.0.0.1"; }
code_block_2 = CodeBlock { "ParentView"; }
code_block_3 = CodeBlock { "ParentView"; }
categories = Categories("OST_Sheets")
all_elements_of_category = ElementsOfCategory(Category=categories)
name = Element.Name(element=all_elements_of_category)
dropdown_data = Custom[DropDown Data](InputName=code_block_3, Keys=name, Values=all_elements_of_category)  # package Data-Shapes; Create data for DropDown input in UI.MultiInputForm ++ . Check out www.data-shapes.net for more infos.
list_create = List.Create(item0=dropdown_data)
inputgroup_data = Custom[InputGroup Data](GroupTitle=code_block_2, Inputs=list_create)  # package Data-Shapes; Creates a group of inputs for UI.MultipleInputForm ++ . Check out www.data-shapes.net for more infos !
code_block_4 = CodeBlock { "Select Views"; }
code_block_5 = CodeBlock { "ChildView"; }
categories_2 = Categories("OST_Sheets")
all_elements_of_category_2 = ElementsOfCategory(Category=categories_2)
name_2 = Element.Name(element=all_elements_of_category_2)
listview_data = Custom[Listview Data](InputName=code_block_5, Keys=name_2, Values=all_elements_of_category_2)  # package Data-Shapes; Create data for ListView input in UI.MultiInputForm ++ . Check out www.data-shapes.net for more infos.
list_create_2 = List.Create(item0=listview_data)
inputgroup_data_2 = Custom[InputGroup Data](GroupTitle=code_block_4, Inputs=list_create_2)
list_create_3 = List.Create(item0=inputgroup_data, item1=inputgroup_data_2)
boolean = BoolSelector(true)
code_block_6 = CodeBlock { "Cancel"; }
code_block_7 = CodeBlock { 400; 700; }
multipleinputform = Custom[MultipleInputForm ++](Description_optional=code_block, Inputs=list_create_3, Toggle=boolean, CancelButtonText_optional=code_block_6, Width_optional=code_block_7.out1)  # package Data-Shapes; Create a form with multiple inputs. see www.data-shapes.net for tutorials and infos!
code_block_8 = CodeBlock { 1; }
getItemAtIndex = List.GetItemAtIndex(list=multipleinputform.User_Inputs, index=code_block_8)
viewports = archilab.Revit.Views.Sheets.Viewports(sheet=getItemAtIndex)
code_block_9 = CodeBlock { 0; }
getItemAtIndex_2 = List.GetItemAtIndex(list=multipleinputform.User_Inputs, index=code_block_9)
viewports_2 = archilab.Revit.Views.Sheets.Viewports(sheet=getItemAtIndex_2)
ʳʰʸᵗʰᵐ_viewport_boxcenter = Rhythm.Revit.Elements.Viewport.BoxCenter(viewport=viewports_2@L2)
ʳʰʸᵗʰᵐ_viewport_setboxcenter = Rhythm.Revit.Elements.Viewport.SetBoxCenter(viewport=viewports@@L2, point=ʳʰʸᵗʰᵐ_viewport_boxcenter, lacing=CrossProduct)
