# Dynamo graph Quan - UI + REVISION TOOL.dyn "UI + REVISION TOOL" (Dynamo 2.6.1.8786)
# packages: Crumple 2022.5.27, LunchBox for Dynamo 2018.7.7, Data-Shapes 2022.2.101

categories = Categories("OST_Sheets")
all_elements_of_category = ElementsOfCategory(Category=categories)
code_block = CodeBlock { "@Quan - ASSIGN REVISION BASED ON PROJECT PARAMETER"; }
file_path = Filename("..\SUPER SAYAJAY.jpg")
code_block_2 = CodeBlock { "Sheet"; }
code_block_3 = CodeBlock { "Select Sheet Project Parameter"; }
code_block_4 = CodeBlock(V=all_elements_of_category) { V[0]; }
parameters = Element.Parameters(element=code_block_4)
name = Parameter.Name(parameter=parameters)
dropdown_data = Custom[DropDown Data](InputName=code_block_3, Keys=name, Values=name)  # package Data-Shapes; Create data for DropDown input in UI.MultiInputForm ++ . Check out www.data-shapes.net for more infos.
list_create = List.Create(item0=dropdown_data)
inputgroup_data = Custom[InputGroup Data](GroupTitle=code_block_2, Inputs=list_create)  # package Data-Shapes; Creates a group of inputs for UI.MultipleInputForm ++ . Check out www.data-shapes.net for more infos !
code_block_5 = CodeBlock { "Revision"; }
code_block_6 = CodeBlock { "Select Revision"; }
element_types = ElementTypes("Revision")
all_elements_of_type = ElementsOfType(element_type=element_types)
name_2 = Element.Name(element=all_elements_of_type)
dropdown_data_2 = Custom[DropDown Data](InputName=code_block_6, Keys=name_2, Values=all_elements_of_type)
list_create_2 = List.Create(item0=dropdown_data_2)
inputgroup_data_2 = Custom[InputGroup Data](GroupTitle=code_block_5, Inputs=list_create_2)
list_create_3 = List.Create(item0=inputgroup_data, item1=inputgroup_data_2)
boolean = BoolSelector(true)
code_block_7 = CodeBlock { "Cancel"; }
code_block_8 = CodeBlock { 600; 400; }
multipleinputform = Custom[MultipleInputForm ++](Description_optional=code_block, Logo_optional=file_path, Inputs=list_create_3, Toggle=boolean, CancelButtonText_optional=code_block_7, Width_optional=code_block_8.out0)  # package Data-Shapes; Create a form with multiple inputs. see www.data-shapes.net for tutorials and infos!
code_block_9 = CodeBlock { 0; }
getItemAtIndex = List.GetItemAtIndex(list=multipleinputform.User_Inputs, index=code_block_9)
getParameterValueByName = Element.GetParameterValueByName(element=all_elements_of_category, parameterName=getItemAtIndex, lacing=CrossProduct)
flatten = List.Flatten(list=getParameterValueByName)
code_block_10 = CodeBlock { 1; }
eq = Equals(x=flatten, y=code_block_10)
boolean_2 = BoolSelector(false)
replaceNulls = Lists.Manage.ReplaceNulls(Data=eq, ReplaceWith=boolean_2)
filterByBoolMask = List.FilterByBoolMask(list=all_elements_of_category, mask=replaceNulls)
code_block_11 = CodeBlock { 1; }
getItemAtIndex_2 = List.GetItemAtIndex(list=multipleinputform.User_Inputs, index=code_block_11)
boolean_3 = BoolSelector(true)
sheets_revisionsadd = Custom[© Sheets.RevisionsAdd](sheets=filterByBoolMask.in, revisions=getItemAtIndex_2, runMe=boolean_3)  # package Crumple; Given a list of sheets, attempt to add the given revisions to each of those sheets.
code_block_12 = CodeBlock { "Nah"; }
